# Grasshopper definition MPDA20_AT-APY-01-kmeans.gh (Grasshopper 1.0.7)

number_slider = Slider(100, range=0..100)
number_slider_2 = Slider(100, range=0..100)
number_slider_3 = Slider(100, range=0..100)
rectangle = Rectangle(Plane=PlaneXY(0, 0, 0), XSize=number_slider, YSize=number_slider, Radius=0)  # -> Rectangle, Length
rectangle_2 = Rectangle(Plane=PlaneXY(0, 0, 0), XSize=number_slider_2, YSize=number_slider_2, Radius=0)  # -> Rectangle, Length
rectangle_3 = Rectangle(Plane=PlaneXY(0, 0, 0), XSize=number_slider_3, YSize=number_slider_3, Radius=0)  # -> Rectangle, Length
boxrec = BoxRectangle(Rectangle=rectangle_3.Rectangle, Height=number_slider_3)
number_slider_4 = Slider(100, range=0..100)
pop2d = Populate2D(Region=rectangle.Rectangle, Count=Slider(7, range=0..10), Seed=1)
pop2d_2 = Populate2D(Region=rectangle_2.Rectangle, Count=Slider(7, range=0..10), Seed=1)
pop3d = Populate3D(Region=boxrec, Count=100, Seed=1)
cir = Circle(Plane=pop2d, Radius=Slider(22, range=0..100))
cir_2 = Circle(Plane=pop2d_2, Radius=Slider(22, range=0..100))
rectangle_4 = Rectangle(Plane=PlaneXY(0, 0, 0), XSize=number_slider_4, YSize=number_slider_4, Radius=0)  # -> Rectangle, Length
voronoi³ = Voronoi3D(Points=pop3d)  # -> Cells, Boundary
boundary = BoundarySurfaces(Edges=cir)
boundary_2 = BoundarySurfaces(Edges=cir_2)
# if cell.Contains(pt) == rg.PointContainment.Inside or cell.Contains(pt) == rg.PointContainment.Coincident
pop2d_3 = Populate2D(Region=rectangle_4.Rectangle, Count=100, Seed=1)
popgeo = PopulateGeometry(Geometry=boundary, Count=Slider(21, range=0..100), Seed=1)
popgeo_2 = PopulateGeometry(Geometry=boundary_2, Count=Slider(21, range=0..100), Seed=1)
_2d_k_means = GhPythonScript(points=flatten(popgeo), K=Slider(5, range=0..10), iterations=Slider(59, range=0..100))  # -> out, a, b, c, d, e; inputs points: list of Point3d, K: Int32, iterations: Int32
# ---------- _2d_k_means: Python ----------
import Rhino.Geometry as rg
import random
import ghpythonlib.components as ghc #node-in-code
import ghpythonlib.treehelpers as th 

#print points
#print type(points)

#print random.random()
#print random.uniform(0,10) -> float
#print random.randint(0,10) -> integer


#TODO implement while loop
"""
K_list= []
random.seed(1)
for i in range(K):
    random_index = random.randint(0,len(points)-1)
    if random_index not in K_list:
        K_list.append(random_index)
"""
K_list = random.sample(range(len(points)), K)


#choose random points
bbox = rg.BoundingBox()
randomPts =[]
for i in K_list:
    pt = points[i]
    randomPts.append(pt)


#newCentroids = []

for i in range(iterations):
    #make a bounding box for our points
    for pt in points:
        #add points to bbox
        bbox.Union(pt)
    
    cells = ghc.Voronoi(randomPts, None, bbox, None)
    
    clusters = []
    for cell in cells:
        cluster = []
        for pt in points:
            if cell.Contains(pt) == rg.PointContainment.Inside or cell.Contains(pt) == rg.PointContainment.Coincident:
                cluster.append(pt)
        clusters.append(cluster)
        
    
    #find the centroids of each cluster
    
    centroids = []
    for cluster in clusters:
        avgPt = rg.Point3d(0,0,0)
        for p in cluster:
            avgPt = avgPt + p
        avgPt = avgPt / len(cluster)
        centroids.append(avgPt)
    randomPts = centroids


a = randomPts
b = bbox
c = cells
d = th.list_to_tree(clusters)
e = centroids
# ---------- end _2d_k_means ----------
_3d_k_means = GhPythonScript(points=flatten(popgeo_2), K=Slider(5, range=0..10), iterations=Slider(59, range=0..100))  # -> out, a, b, c, d, e; inputs points: list of Point3d, K: Int32, iterations: Int32
# ---------- _3d_k_means: Python ----------
import Rhino.Geometry as rg
import random
import ghpythonlib.components as ghc #node-in-code
import ghpythonlib.treehelpers as th 

#print points
#print type(points)

#print random.random()
#print random.uniform(0,10) -> float
#print random.randint(0,10) -> integer


#TODO implement while loop
"""
K_list= []
random.seed(1)
for i in range(K):
    random_index = random.randint(0,len(points)-1)
    if random_index not in K_list:
        K_list.append(random_index)
"""
K_list = random.sample(range(len(points)), K)


#choose random points
bbox = rg.BoundingBox()
randomPts =[]
for i in K_list:
    pt = points[i]
    randomPts.append(pt)


#newCentroids = []

for i in range(iterations):
    #make a bounding box for our points
    for pt in points:
        #add points to bbox
        bbox.Union(pt)
    
    cells = ghc.Voronoi(randomPts, None, bbox, None)
    
    clusters = []
    for cell in cells:
        cluster = []
        for pt in points:
            if cell.Contains(pt) == rg.PointContainment.Inside or cell.Contains(pt) == rg.PointContainment.Coincident:
                cluster.append(pt)
        clusters.append(cluster)
        
    
    #find the centroids of each cluster
    centroids = []
    for cluster in clusters:
        avgPt = rg.Point3d(0,0,0)
        for p in cluster:
            avgPt = avgPt + p
        avgPt = avgPt / len(cluster)
        centroids.append(avgPt)
    randomPts = centroids


a = randomPts
b = bbox
c = cells
d = th.list_to_tree(clusters)
e = centroids
# ---------- end _3d_k_means ----------
data = Data(_2d_k_means.e)
cir_3 = Circle(Plane=data, Radius=2)
data_2 = Data(_3d_k_means.e)
boundary_3 = BoundarySurfaces(Edges=cir_3)
preview = CustomPreview(Geometry=boundary_3, Material=ColourSwatch(SwatchColor=RGB(255, 0, 0)))
cir_4 = Circle(Plane=data_2, Radius=2)
boundary_4 = BoundarySurfaces(Edges=cir_4)
preview_2 = CustomPreview(Geometry=boundary_4, Material=ColourSwatch(SwatchColor=RGB(255, 0, 0)))
tstat = TreeStatistics(Tree=_2d_k_means.d)  # -> Paths, Length, Count
tstat_2 = TreeStatistics(Tree=_3d_k_means.d)  # -> Paths, Length, Count
panel = Panel(_2d_k_means.a)
panel_2 = Panel(_3d_k_means.a)
data_3 = Data(_2d_k_means.c)
data_4 = Data(_3d_k_means.c)
series = Series(Start=0, Step=1, Count=tstat.Count)
series_2 = Series(Start=0, Step=1, Count=tstat_2.Count)
gradient = Gradient(
    LowerLimit=0,
    UpperLimit=tstat.Count,
    Parameter=series,
    stops=[0: RGB(243, 57, 0), 0.1: RGB(236, 27, 60), 0.2: RGB(210, 0, 118), 0.3: RGB(103, 0, 120), 0.4: RGB(39, 72, 161), 0.5: RGB(1, 192, 229), 0.6: RGB(18, 178, 90), 0.7: RGB(79, 186, 8), 0.8: RGB(220, 237, 32), 0.9: RGB(247, 159, 20), 1: RGB(243, 57, 0)])
gradient_2 = Gradient(
    LowerLimit=0,
    UpperLimit=tstat_2.Count,
    Parameter=series_2,
    stops=[0: RGB(243, 57, 0), 0.1: RGB(236, 27, 60), 0.2: RGB(210, 0, 118), 0.3: RGB(103, 0, 120), 0.4: RGB(39, 72, 161), 0.5: RGB(1, 192, 229), 0.6: RGB(18, 178, 90), 0.7: RGB(79, 186, 8), 0.8: RGB(220, 237, 32), 0.9: RGB(247, 159, 20), 1: RGB(243, 57, 0)])
preview_3 = CustomPreview(Geometry=_2d_k_means.d, Material=graft(gradient))
preview_4 = CustomPreview(Geometry=_3d_k_means.d, Material=graft(gradient_2))
