# Grasshopper definition MPDA20_AT-APY-02-kmeans-multid.gh (Grasshopper 1.0.7)
# plug-ins: Kangaroo2 Components

number_slider = Slider(40, range=0..50)

# ----
# mesh generation
# step 1: here we make a simple mesh to analyze (this should change in your homework)
mplane = MeshPlane(
    Boundary={Plane=PlaneXY(0, 0, 0), Size=Domain2(u=-10..10, v=-10..10)},
    WidthCount=number_slider,
    HeightCount=number_slider)  # -> Mesh, Area
nv = NakedVertices(Mesh=mplane.Mesh)  # -> ClothedIndex, NakedIndex, ClothedPts, NakedPts
medges = MeshEdges(Mesh=mplane.Mesh)  # -> NakedEdges, InteriorEdges, NonManifoldEdges
mc = MeshCorners(Mesh=mplane.Mesh, Angle=2.35619449)
Z = UnitZ(Factor=Slider(0.02, range=0..10))
length_line = LengthLine(Line=[medges.NakedEdges, medges.InteriorEdges], Strength=10)
anchor = Anchor(Point=mc, Strength=10000)
show = Show(G=mplane.Mesh)
load = Load(Point=nv.ClothedPts, ForceVector=Z, Weighting=1)
entwine = Entwine(Branch00=show, Branch01=length_line, Branch02=load, Branch03=anchor, FlattenInputs=True)
solver = Solver(GoalObjects=entwine, Reset=Button(), Threshold=1e-15, Tolerance=0.01, On=Toggle(False))  # -> I, V, O
bang = ExplodeTree(Data=solver.O)  # -> Branch0, Branch1

anymesh = Data(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)
explode_mesh = GhPythonScript(M=anymesh)  # -> M
# ---------- explode_mesh: Python ----------
import Rhino

def meshFromMeshFaces(mesh):
    meshList = []
    for i, face in enumerate(mesh.Faces):

        new_mesh = Rhino.Geometry.Mesh()

        new_mesh.Vertices.Add(mesh.Vertices[face[0]])
        new_mesh.Vertices.Add(mesh.Vertices[face[1]])
        new_mesh.Vertices.Add(mesh.Vertices[face[2]])
        if face.IsQuad: new_mesh.Vertices.Add(mesh.Vertices[face[3]])
        if face.IsTriangle:
            new_mesh.Faces.AddFace(0, 1, 2)
        else:
            new_mesh.Faces.AddFace(0, 1, 2, 3)
        
        new_mesh.Normals.ComputeNormals()
        meshList.append(new_mesh)
    return meshList
    
M = meshFromMeshFaces(M)
# ---------- end explode_mesh ----------
k_means = GhPythonScript(M=flatten(explode_mesh), K=Slider(10, range=0..20))  # -> out, clusterIndexes; inputs M: list of Mesh, K: Int32
# ---------- k_means: Python ----------
import Rhino.Geometry as rg
import random
import ghpythonlib.treehelpers as th 
import MPDA20_Util as mpda 

#1. MAKE VECTORS TO ANALYZE ///////////////////////////////////////////////

#make a list where will will store all the n-dimensional vectors. It will be a list of lists
allVectors= []

#we iterate through every mesh with a for loop
for i in range(len(M)):
    #here make a list that will be our n-dimensional vector called nVector
    nVector  =[]

    #for every mesh, we get two lines from oposing vertices
    line1 = rg.Line(M[i].Vertices[0], M[i].Vertices[2])
    line2 = rg.Line(M[i].Vertices[1], M[i].Vertices[3])
    
    #then we store the length of those lines, as our first two dimentions of our nVector
    nVector.append(line1.Length) #dimension 1
    nVector.append(line2.Length) #dimension 2
    
    #next, we find the parameters where each of those lines intersect, per each of the lines
    lli = rg.Intersect.Intersection.LineLine(line1, line2)
    p1 = lli[1]
    p2 = lli[2]
    
    #then we store those parameters as third and fourth dimentions of our nVector
    nVector.append(p1) #third dimension
    nVector.append(p2) #fourth dimension

    #next, we want to get the angle between those vectors
    #for which we need to convert the lines to vectors to calculate the angle
    #we do this using vector substraction (https://www.dummies.com/education/science/physics/how-to-subtract-vectors/)
    v1 = line1.To - line1.From 
    v2 = line2.To - line2.From 
    
    #then, we get the angle from those two vectors
    ang = rg.Vector3d.VectorAngle(v1,v2)
    nVector.append(ang)
    
    allVectors.append(nVector) #append the nVector to a list of allVectors 



#2. K-MEANS ALGORTITHM ///////////////////////////////////////////////

#2.0 add indexes to every vector in the vector list, in order to identify them after clustering
allVectors = [ (i,v) for i,v in enumerate(allVectors) ] #this is called a list comprehension (look it up, if you are interested)

#2.1 find random indexes using random library 
random.seed(1) #we may want to keep the seed consistent, so that the number doesn´t change every time
K_list = random.sample(range(len(M)), K)

#2.2 find some initial random centroids within our ndimensional vectors
centroids = []
for k in K_list:
    centroids.append(allVectors[k])


#2.3 iterate until the condition in the end fulfils (see while loops)
while True:
    
    #for each vector, get the closest centroid and return a cluster
    #here we need to use the mpda library that I shared
    clusters = mpda.findnearest(allVectors, centroids) # findnearest function clusters nvectors to the nearest centroids, and returns a list of clustered nvectors
    
    #then we find new centroids, by averaging all of the vectors in a cluster
    new_centroids = []
    for cluster in clusters:
        
        new_centroid= mpda.avgvecs(cluster) #avgvecs function takes a list of nvectors and returns an average nvector
        new_centroids.append(new_centroid) #we store all of the new centroids in a new list of centroids

    #last, we replace the list of centroids, unless the centroids haven´t changed
    if new_centroids == centroids: break #exits the while loop if the new centroids are the same as the old ones
    else: centroids = new_centroids

#2.4 finally, we need to get the item from our nvector list, which will be the identifier for the meshface in the overall mesh
allIndexes = []
for cluster in clusters:
    cluster_indexes =[]
    for nvector in cluster:
        cluster_indexes.append(nvector[0])# we only need to append the index (item 0 of indexAndVector), not the nVector
    allIndexes.append(cluster_indexes)


#output the indexes
clusterIndexes = th.list_to_tree(allIndexes)
# ---------- end k_means ----------
item = ListItem(List=explode_mesh, Index=k_means.clusterIndexes, Wrap=True)
tstat = TreeStatistics(Tree=item)  # -> Paths, Length, Count
series = Series(Start=0, Step=1, Count=tstat.Count)
gradient = Gradient(
    LowerLimit=0,
    UpperLimit=tstat.Count,
    Parameter=series,
    stops=[0: RGB(243, 57, 0), 0.1: RGB(236, 27, 60), 0.2: RGB(210, 0, 118), 0.3: RGB(103, 0, 120), 0.4: RGB(39, 72, 161), 0.5: RGB(1, 192, 229), 0.6: RGB(18, 178, 90), 0.7: RGB(79, 186, 8), 0.8: RGB(220, 237, 32), 0.9: RGB(247, 159, 20), 1: RGB(243, 57, 0)])
preview = CustomPreview(Geometry=item, Material=graft(gradient))
