# Grasshopper definition MPDA20_AT-APY-02-kmeans-assignment02.gh (Grasshopper 1.0.7)

any_data = Data([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])
nvectors = GhPythonScript(M=flatten(any_data))  # -> out, nVectors; inputs M: list of Mesh
# ---------- nvectors: Python ----------
import Rhino.Geometry as rg
import ghpythonlib.treehelpers as th 

#1. MAKE VECTORS TO ANALYZE ///////////////////////////////////////////////
#make a list where will will store all the n-dimensional vectors. It will be a list of lists
allVectors= []

#we iterate through every mesh with a for loop
for i in range(len(M)):
    #here make a list that will be our n-dimensional vector called nVector
    nVector  =[]

    #for every mesh, we get two lines from oposing vertices
    line1 = rg.Line(M[i].Vertices[0], M[i].Vertices[2])
    line2 = rg.Line(M[i].Vertices[1], M[i].Vertices[3])
    
    #then we store the length of those lines, as our first two dimentions of our nVector
    nVector.append(line1.Length) #dimension 1
    nVector.append(line2.Length) #dimension 2
    
    #next, we find the parameters where each of those lines intersect, per each of the lines
    lli = rg.Intersect.Intersection.LineLine(line1, line2)
    p1 = lli[1]
    p2 = lli[2]
    
    #then we store those parameters as third and fourth dimentions of our nVector
    nVector.append(p1) #third dimension
    nVector.append(p2) #fourth dimension

    #next, we want to get the angle between those vectors
    #for which we need to convert the lines to vectors to calculate the angle
    #we do this using vector substraction (https://www.dummies.com/education/science/physics/how-to-subtract-vectors/)
    v1 = line1.To - line1.From 
    v2 = line2.To - line2.From 
    
    #then, we get the angle from those two vectors
    ang = rg.Vector3d.VectorAngle(v1,v2)
    nVector.append(ang)
    
    #finally, we append the append the vector that corresponds to that mesh to the list of allVectors
    #its important that we also include the index of this face in the larger mesh, so that we can identify it later
    
    allVectors.append(nVector) #here we append that list to the allVectors list


#output the indexes
nVectors = th.list_to_tree(allVectors)
# ---------- end nvectors ----------
k_means = GhPythonScript(nVectors=nvectors.nVectors, K=Slider(10, range=0..20))  # -> out, clusterIndexes, clusterVectors; inputs nVectors: tree, K: Int32
# ---------- k_means: Python ----------
import Rhino.Geometry as rg
import ghpythonlib.treehelpers as th 
import MPDA20_Util as mpda 
import random


allVectors = []

#1. append indexes to vectors, to identify them after clustering
for i in range(nVectors.BranchCount):
    allVectors.append((i,nVectors.Branch(i)))


#2. K-MEANS ALGORTITHM ///////////////////////////////////////////////

#2.1 find random indexes using random library 
random.seed(1) #we may want to keep the seed consistent, so that the number doesn´t change every time
K_list = random.sample(range(len(allVectors)), K)

#2.2 find some initial random centroids within our ndimensional vectors
centroids = []
for k in K_list:
    centroids.append(allVectors[k])


#2.3 iterate until the condition in the end fulfils (see while loops)
while True:
    
    #for each vector, get the closest centroid and return a cluster
    #here we need to use the mpda library that I shared
    clusters = mpda.findnearest(allVectors, centroids) # findnearest function clusters nvectors to the nearest centroids, and returns a list of clustered nvectors
    
    #then we find new centroids, by averaging all of the vectors in a cluster
    new_centroids = []
    for cluster in clusters:
        
        new_centroid= mpda.avgvecs(cluster) #avgvecs function takes a list of nvectors and returns an average nvector
        new_centroids.append(new_centroid) #we store all of the new centroids in a new list of centroids

    #last, we replace the list of centroids, unless the centroids haven´t changed
    if new_centroids == centroids: break #exits the while loop if the new centroids are the same as the old ones
    else: centroids = new_centroids

#2.4 finally, we need to get the item from our nvector list, which will be the identifier for the meshface in the overall mesh
allClusterIndexes = []
allClusterVectors= []

#2.5 separete indexes and nvectors
for cluster in clusters:
    cluster_indexes =[]
    cluster_vectors =[]
    for nvector in cluster:
        cluster_indexes.append(nvector[0])# append the index (item 0 of indexAndVector)
        cluster_vectors.append(nvector[1])# append the nvectors (item 1 of indexAndVector)
    allClusterIndexes.append(cluster_indexes)
    allClusterVectors.append(cluster_vectors)


#output the indexes and vector clusters
clusterIndexes = th.list_to_tree(allClusterIndexes)
clusterVectors = th.list_to_tree(allClusterVectors)
# ---------- end k_means ----------
item = ListItem(List=any_data, Index=k_means.clusterIndexes, Wrap=True)
tstat = TreeStatistics(Tree=item)  # -> Paths, Length, Count
series = Series(Start=0, Step=1, Count=tstat.Count)
gradient = Gradient(
    LowerLimit=0,
    UpperLimit=tstat.Count,
    Parameter=series,
    stops=[0: RGB(243, 57, 0), 0.1: RGB(236, 27, 60), 0.2: RGB(210, 0, 118), 0.3: RGB(103, 0, 120), 0.4: RGB(39, 72, 161), 0.5: RGB(1, 192, 229), 0.6: RGB(18, 178, 90), 0.7: RGB(79, 186, 8), 0.8: RGB(220, 237, 32), 0.9: RGB(247, 159, 20), 1: RGB(243, 57, 0)])
preview = CustomPreview(Geometry=item, Material=graft(gradient))
