# Grasshopper definition GrasshopperToPython.gh (Grasshopper 1.0.7)

# 1. list
series = Series(Start=0, Step=1, Count=10)
python = GhPythonScript(x=Slider(0, range=0..10), U=Slider(10, range=0..10), V=Slider(10, range=0..10))  # -> out, a, b, c, d, e, f, g; inputs x: Int32
# ---------- python: Python ----------
import Rhino.Geometry as rg
import ghpythonlib.treehelpers as th
import math
import ghpythonlib.components as ghc

point1 = rg.Point3d(0,0,0)

a = point1

#this is how you initialize a list in python
pointList1 = []
for i in range(10):
    pt = rg.Point3d(i, 0, 0)
    pointList1.append(pt)

#print pointList1
a = pointList1

#make a second list of points
pointList2 = []
for i in range(10):
    pt = rg.Point3d(i, 20, 0)
    pointList2.append(pt)

#print pointList2
b = pointList2

#Create a line from two lists
line = rg.Line(pointList1[x], pointList2[x])
c = line


lineList = []
for i in range(len(pointList1)):
    line = rg.Line(pointList1[i], pointList2[i])
    lineList.append(line)
c = lineList


#divide line into points

"""
midPt = rg.Line.PointAt(lineList[x], 0.5)
d = midPt
"""


allDivPts = []
for j in range(len(lineList)):
    divPts = [] #my list of division points
    for i in range(11):
        divPt = rg.Line.PointAt(lineList[j], i/10)
        
        vec= rg.Vector3d(divPt)
        vecLen = vec.Length
        mag = math.sin(vecLen)
        transVec = -rg.Vector3d.ZAxis * mag
        
        newPt = divPt - transVec
        divPts.append(newPt)

    allDivPts.append(divPts)

d = th.list_to_tree(allDivPts)


#make a curve from list of points
curveList = []
for i in range(len(allDivPts)):
    curve = rg.Curve.CreateInterpolatedCurve(allDivPts[i], 3)
    curveList.append(curve)
e= curveList


#create a loft surface from curves
surface = rg.Brep.CreateFromLoft(curveList, rg.Point3d.Unset, rg.Point3d.Unset, rg.LoftType.Normal, False)
f = surface


#create a mesh from surface
mesh = ghc.MeshSurface(surface, U, V, True, False)
g = mesh
# ---------- end python ----------
panel = Panel(series)
data = Data(python.f)
data_2 = Data(python.e)
data_3 = Data(python.g)
# 2. points
pt = ConstructPoint(XCoordinate=series, YCoordinate=0, ZCoordinate=0)
pt_2 = ConstructPoint(XCoordinate=series, YCoordinate=Slider(10, range=0..10), ZCoordinate=0)
# 3. line
ln = Line(StartPoint=pt, EndPoint=pt_2)
# 4. divide curve
divide = DivideCurve(Curve=ln, Count=10, Kinks=False)  # -> Points, Tangents, Parameters
vec = Vector(divide.Points)
vlen = VectorLength(Vector=vec)
sin = Sine(Value=vlen)
Z = UnitZ(Factor=sin)
# 5. vector
move = Move(Geometry=divide.Points, Motion=Z)  # -> Geometry, Transform
# 6. curve
intcrv = Interpolate(Vertices=move.Geometry, Degree=3, Periodic=False, KnotStyle=1)  # -> Curve, Length, Domain
# 7. surface
loft = Loft(
    Curves=flatten(intcrv.Curve),
    Options={Adjust=False, Closed=False, LoftEnds=0, LoftSimp=0, LoftType=0, Rebuild=10, Refit=0.01})
# 8. mesh
mesh_uv = MeshSurface(Surface=loft, UCount=Slider(10, range=0..10), VCount=Slider(7, range=0..10), Overhang=True, Equalize=False)
